% Simulink data dictionary dataGenerator.sldd

EstimateFuelConsumption = 0
swbId = 1

genset = struct(
  Sb=9100000,
  ID=1,
  powerFactor=0.85,
  w_b=376.9911,
  r=0.0019,
  xs=0.48,
  H=2.4054,
  D=0.025,
  fixThrottleTime=1.797693e+308,
  fixThrottle=0,
  wMax=1.1,
  wMin=0.9,
  wBreakerTime=0.1,
  governor=struct(
    Kp=12.08644,
    Ki=12.08644,
    Kd=12.08644,
    N=0.1,
    droop=0.02,
    Kb=1,
    wNoLoad=1.010101,
    rampMax=0.08109741,
    deltaU=0.19882),
  uMin=0,
  uMax=1.5,
  pMax=1.1,
  avr=struct(maxFieldVoltage=20, minFieldVoltage=0.01, kp=40, ki=10, T=0.01, droop=0.01, v0=0.6766117),
  theta0=0.2063858,
  turbo=struct(
    dm0=0.015939,
    dm1=0.15579,
    dm2=0.025497,
    FCmax=0.295839,
    FCdw2=repmat(6.09, 6, 1),
    FCdp1=0.5279,
    FCdp2=10.471),
  omega0=1,
  u0=0.525475)

Sig = Simulink.Signal()